# Grasshopper definition salma assignment 01.gh (Grasshopper 1.0.7)

number_slider = Slider(5, range=0..10)
number_slider_2 = Slider(3, range=0..10)
number_slider_3 = Slider(5, range=0..10)
number_slider_4 = Slider(5, range=0..10)
number_slider_5 = Slider(6, range=0..10)
number_slider_6 = Slider(6, range=0..10)
get_integer = GetInteger([number_slider, number_slider_2, number_slider_3], AtLeast=1, AtMost=2147483647, Maximum=2147483647, Minimum=-2147483648)
center_box = CenterBox(
    Base=PlaneXY(0, 0, 0),
    X=[number_slider, get_integer],
    Y=[number_slider_2, get_integer],
    Z=[number_slider_3, get_integer])
get_integer_2 = GetInteger(
    [number_slider_6, number_slider_5, number_slider_4],
    AtLeast=1,
    AtMost=2147483647,
    Maximum=2147483647,
    Minimum=-2147483648)
get_geometry = GetGeometry(center_box, AtLeast=1, AtMost=2147483647, Filter=1074004029)
box_array = BoxArray(
    Geometry=get_geometry,
    Cell=center_box,
    XCount=[number_slider_6, get_integer_2],
    YCount=[number_slider_5, get_integer_2],
    ZCount=[number_slider_4, get_integer_2])  # -> Geometry, Transform
random_reduce = RandomReduce(List=box_array.Geometry, Reduction=Slider(6, range=0..10), Seed=Slider(53, range=0..100))
custom_preview = CustomPreview(Geometry=random_reduce, Material=ColourSwatch(SwatchColor=RGB(149, 234, 255)))
context_bake = ContextBake(Geometry=random_reduce)
